# Grasshopper definition vae_gh.gh (Grasshopper 1.0.7)
# plug-ins: LunchBox, treesloth01

data = Data(Tree({0}: ["z1 z2 columnR1 columnR2 columnR3 columnR4 columnR5 roofControl1 roofControl2 shift kickerElev mass maxDispl elasticEnergy", "-1.156337 -1.110596 0.973587 0.895914 0.498324 0.411053 0.650034 1.450239 0.135536 0.33797 0.602411 2247.176941 4.647469 1.108819", "-1.156337 -0.996667 0.954143 0.881973 0.490672 0.421892 0.636385 1.391252 0.128776 0.321119 0.542823 2234.144394 4.489052 1.066583", "-1.156337 -0.882738 0.9347 0.868032 0.483021 0.432731 0.622737 1.332266 0.122016 0.304269 0.483234 2221.445744 4.362211 1.033506", "-1.156337 -0.768809 0.915256 0.854091 0.47537 0.44357 0.609088 1.273279 0.115256 0.287419 0.423646 2209.130879 4.262797 1.008363", "-1.156337 -0.65488 0.895812 0.84015 0.467719 0.454409 0.59544 1.214293 0.108496 0.270568 0.364057 2197.351288 4.186212 0.990216"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], {1}: ["z1 z2 columnR1 columnR2 columnR3 columnR4 columnR5 roofControl1 roofControl2 shift kickerElev mass maxDispl elasticEnergy", "-1.156337 -1.110596 1.002099 0.935083 0.563879 0.375939 0.615461 1.498879 0.096026 0.743471 0.591307 3310.307508 4.7025 0.99457", "-1.156337 -0.996667 0.982449 0.919031 0.555271 0.388971 0.60226 1.436623 0.084246 0.730639 0.531646 3005.224205 4.987323 1.035302", "-1.156337 -0.882738 0.962649 0.902945 0.546831 0.401932 0.589013 1.373999 0.072479 0.717967 0.47213 2715.43805 5.353969 1.092125", "-1.156337 -0.768809 0.94285 0.886858 0.538391 0.414892 0.575765 1.311375 0.060711 0.705295 0.412614 2698.760227 5.280746 1.061905", "-1.156337 -0.65488 0.922408 0.870542 0.529307 0.428262 0.562225 1.248274 0.049657 0.692692 0.352755 2682.7848 5.209672 1.036791"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], {2}: ["z1 z2 columnR1 columnR2 columnR3 columnR4 columnR5 roofControl1 roofControl2 shift kickerElev mass maxDispl elasticEnergy", "-1.156337 -1.110596 1.003749 0.959538 0.601232 0.377396 0.567876 1.497479 0.038052 1.203743 0.56839 3752.488877 5.654862 1.169942", "-1.156337 -0.996667 0.981615 0.940907 0.59082 0.385468 0.552755 1.439047 0.028901 1.207374 0.512438 3396.295746 6.190756 1.257451", "-1.156337 -0.882738 0.953455 0.920803 0.578893 0.392699 0.537557 1.370822 0.020033 1.219715 0.454566 3372.735981 6.292042 1.255025", "-1.156337 -0.768809 0.926231 0.902796 0.568512 0.404379 0.524114 1.296563 0.00875 1.218469 0.392917 3266.980658 6.712858 1.332562", "-1.156337 -0.65488 0.89906 0.884908 0.558219 0.416312 0.510771 1.221961 -0.002671 1.216451 0.331053 3326.115015 6.351663 1.222103"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]))

# ---- group: RH_IN: Z2
number_slider = Slider(0.15, range=0..1)

# ---- group: RH_IN: Z1
# Coordinates in the latent space
# mapped from 0 to 1
number_slider_2 = Slider(0.15, range=0..1)

# ---- group: RH_IN: DIV2
number_slider_3 = Slider(3, range=0..10)

# ---- group: RH_IN: DIV1
# Numbers for grid division
number_slider_4 = Slider(3, range=0..10)

# ---- group: RH_IN:p
number_slider_5 = Slider(0, range=0..1)

# ----
list_item = ListItem(List=data, Index=0, Wrap=True)  # -> flatten(Item)
data_2 = Data(["z1 z2 columnR1 columnR2 columnR3 columnR4 columnR5 roofControl1 roofControl2 shift kickerElev mass maxDispl elasticEnergy", "-1.156337 -1.110596 0.973587 0.895914 0.498324 0.411053 0.650034 1.450239 0.135536 0.33797 0.602411 2247.176941 4.647469 1.108819", "-1.156337 -0.996667 0.954143 0.881973 0.490672 0.421892 0.636385 1.391252 0.128776 0.321119 0.542823 2234.144394 4.489052 1.066583", "-1.156337 -0.882738 0.9347 0.868032 0.483021 0.432731 0.622737 1.332266 0.122016 0.304269 0.483234 2221.445744 4.362211 1.033506", "-1.156337 -0.768809 0.915256 0.854091 0.47537 0.44357 0.609088 1.273279 0.115256 0.287419 0.423646 2209.130879 4.262797 1.008363", "-1.156337 -0.65488 0.895812 0.84015 0.467719 0.454409 0.59544 1.214293 0.108496 0.270568 0.364057 2197.351288 4.186212 0.990216"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])
list_length = ListLength(List=list_item)
construct_domain = ConstructDomain(DomainStart=0, DomainEnd=expr("x-1", list_length))
remap_numbers = RemapNumbers(Value=number_slider_5, Source=Domain(0, 1), Target=construct_domain)  # -> Mapped, Clipped
concatenate = Concatenate(Fragment_A="{", Fragment_B=remap_numbers.Mapped, A="}")
tree_branch = TreeBranch(Tree=data, Path=concatenate, MaintainPaths=True)
data_3 = Data(tree_branch)

# ----
# Process data
text_split = TextSplit(Text=data_3, Separators=" ")
list_item_2 = ListItem(List=text_split, Index=[2, 3, 4, 5, 6, 7, 8, 9, 10, 11], Wrap=True)  # -> simplify(Item)
flip_matrix = FlipMatrix(Data=list_item_2)
number_slider_6 = Slider(0, range=0..100)
cull_index = CullIndex(List=flip_matrix, Indices=0, Wrap=True)
list_item_3 = ListItem(List=text_split, Index=0, Wrap=True)
list_item_4 = ListItem(List=text_split, Index=1, Wrap=True)
list_item_5 = ListItem(List=text_split, Index=11, Wrap=True)
flip_matrix_2 = FlipMatrix(Data=cull_index)  # -> simplify(Data)
cull_index_2 = CullIndex(List=flatten(list_item_3), Indices=number_slider_6, Wrap=True)
cull_index_3 = CullIndex(List=flatten(list_item_4), Indices=number_slider_6, Wrap=True)
cull_index_4 = CullIndex(List=flatten(list_item_5), Indices=number_slider_6, Wrap=True)
bounds = Bounds(Numbers=cull_index_4)
remap_numbers_2 = RemapNumbers(Value=cull_index_4, Source=bounds, Target=Domain(0, 0.5))  # -> Mapped, Clipped

construct_point = ConstructPoint(XCoordinate=cull_index_2, YCoordinate=cull_index_3, ZCoordinate=0)

# ----
# Create a grid of points
# in the latent space
sort_list = SortList(Keys=cull_index_2)  # -> Keys, ValuesValuesA
sort_list_2 = SortList(Keys=cull_index_3)  # -> Keys, ValuesValuesA
list_item_6 = ListItem(List=sort_list.Keys, Index=0, Wrap=True)  # -> Item1, Item
list_item_7 = ListItem(List=sort_list_2.Keys, Index=0, Wrap=True)  # -> Item1, Item
construct_domain_2 = ConstructDomain(DomainStart=list_item_6.Item, DomainEnd=list_item_6.Item1)
construct_domain_3 = ConstructDomain(DomainStart=list_item_7.Item, DomainEnd=list_item_7.Item1)
subtraction = Subtraction(A=list_item_6.Item1, B=list_item_6.Item)
subtraction_2 = Subtraction(A=list_item_7.Item1, B=list_item_7.Item)
rectangle = Rectangle(Plane=PlaneXY(0, 0, 0), XSize=construct_domain_2, YSize=construct_domain_3, Radius=0)  # -> Rectangle, Length
division = Division(A=subtraction, B=number_slider_4)
division_2 = Division(A=subtraction_2, B=number_slider_3)
boundary_surfaces = BoundarySurfaces(Edges=rectangle.Rectangle)
mesh_surface = MeshSurface(Surface=boundary_surfaces, UCount=number_slider_4, VCount=number_slider_3, Overhang=True, Equalize=False)
deconstruct_mesh = DeconstructMesh(Mesh=mesh_surface)  # -> Vertices, Faces, Colours, Normals

# ----
# Visualize moving point
remap_numbers_3 = RemapNumbers(Value=number_slider_2, Source=Domain(0, 1), Target=construct_domain_3)  # -> Mapped, Clipped
remap_numbers_4 = RemapNumbers(Value=number_slider, Source=Domain(0, 1), Target=construct_domain_2)  # -> Mapped, Clipped
sort_list_3 = SortList(Keys=remap_numbers_2.Mapped)  # -> Keys, ValuesValuesA
construct_point_2 = ConstructPoint(XCoordinate=cull_index_2, YCoordinate=cull_index_3, ZCoordinate=0)
construct_point_3 = ConstructPoint(XCoordinate=remap_numbers_3.Mapped, YCoordinate=remap_numbers_4.Mapped, ZCoordinate=0)
list_item_8 = ListItem(List=sort_list_3.Keys, Index=0, Wrap=True)  # -> Item1, Item
closest_point = ClosestPoint(Point=construct_point_3, Cloud=construct_point_2)  # -> ClosestPoint, CPIndex, Distance
list_item_9 = ListItem(List=remap_numbers_2.Mapped, Index=closest_point.CPIndex, Wrap=True)
number_slider_7 = Slider(10, range=0..10)
unit_z = UnitZ(Factor=list_item_9)
move = Move(Geometry=closest_point.ClosestPoint, Motion=unit_z)  # -> Geometry, Transform
gradient = Gradient(
    LowerLimit=list_item_8.Item,
    UpperLimit=list_item_8.Item1,
    Parameter=list_item_9,
    stops=[0.145: RGB(128, 255, 128), 0.85: RGB(192, 64, 0)])
mesh_sphere = MeshSphere(Base=move.Geometry, Radius=Slider(0.1, range=0..0.1), UCount=number_slider_7, VCount=number_slider_7)
mcol = MeshColours(Mesh=graft(mesh_sphere), Colours=graft(gradient))  # -> flatten(Mesh)

# ----
# Get Parameters relating to points on map
closest_point_2 = ClosestPoint(Point=deconstruct_mesh.Vertices, Cloud=construct_point)  # -> ClosestPoint, CPIndex, Distance
concatenate_2 = Concatenate(Fragment_A="{", Fragment_B=closest_point.CPIndex, A="}")
concatenate_3 = Concatenate(Fragment_A="{", Fragment_B=closest_point_2.CPIndex, A="}")
tree_branch_2 = TreeBranch(Tree=flip_matrix_2, Path=concatenate_2, MaintainPaths=True)
tree_branch_3 = TreeBranch(Tree=flip_matrix_2, Path=concatenate_3, MaintainPaths=True)
cull_index_5 = CullIndex(List=tree_branch_3, Indices=-1, Wrap=True)
flip_matrix_3 = FlipMatrix(Data=cull_index_5)
cull_index_6 = CullIndex(List=tree_branch_2, Indices=-1, Wrap=True)
insert_items = InsertItems(List=flip_matrix_3, Indices=0, Wrap=True)
flip_matrix_4 = FlipMatrix(Data=insert_items)  # -> simplify(Data)
entwine = Entwine(Branch00=cull_index_6, FlattenInputs=True)  # -> simplify(Result)
trim_tree = TrimTree(Tree=entwine, Depth=1)
merge = Merge(Data1=trim_tree, Data2=flip_matrix_4)
clean_tree = CleanTree(RemoveNulls=True, RemoveInvalid=True, RemoveEmpty=False, Tree=merge)

# ----
# Create a grid for samples
construct_point_4 = ConstructPoint(XCoordinate=10, YCoordinate=0, ZCoordinate=0)
number_slider_8 = Slider(40, range=0..100)
unit_x = UnitX(Factor="100")
move_2 = Move(Geometry=construct_point_4, Motion=unit_x)  # -> Geometry, Transform
rectangle_2 = Rectangle(Plane=move_2.Geometry, XSize=number_slider_8, YSize=number_slider_8, Radius=0)  # -> Rectangle, Length
boundary_surfaces_2 = BoundarySurfaces(Edges=rectangle_2.Rectangle)
unit_x_2 = UnitX(Factor="-1000")
mesh_surface_2 = MeshSurface(Surface=boundary_surfaces_2, UCount=number_slider_4, VCount=number_slider_3, Overhang=True, Equalize=False)
move_3 = Move(Geometry=construct_point_4, Motion=unit_x_2)  # -> Geometry, Transform
deconstruct_mesh_2 = DeconstructMesh(Mesh=mesh_surface_2)  # -> Vertices, Faces, Colours, Normals
merge_2 = Merge(Data1=flatten(move_3.Geometry), Data2=flatten(deconstruct_mesh_2.Vertices))

list_item_10 = ListItem(List=tree_branch_3, Index=-1, Wrap=True)
round = Round(Number=list_item_10)  # -> Nearest, Floor, Ceiling
vector = Vector(deconstruct_mesh_2.Vertices)
data_4 = Data("Verdana")
vector_xyz = VectorXYZ(XComponent=Slider(1, range=0..10), YComponent=0, ZComponent=0)  # -> Vector, Length
font = Panel(data_4)
c_script = CSharpScript(face=font, bold=Toggle(False), italics=Toggle(False), size=Slider(1, range=1..20), content=round.Nearest)  # -> out, A; inputs face: String, bold: Boolean, italics: Boolean, size: Double, content: String
# ---------- c_script: C# ----------
    if(content != null && content != String.Empty
    && face != null && face != String.Empty ){

      if(size == 0)
        size = 5;

      Rhino.DocObjects.Font.FontStyle fontStyle = Rhino.DocObjects.Font.FontStyle.Upright;
      if (italics) fontStyle = Rhino.DocObjects.Font.FontStyle.Italic;
      Rhino.DocObjects.Font.FontWeight fontWeight = Rhino.DocObjects.Font.FontWeight.Normal;
      if (bold) fontWeight = Rhino.DocObjects.Font.FontWeight.Bold;

      bool underlined = false;
      bool strikethrough = false;

      Rhino.DocObjects.Font font = new Rhino.DocObjects.Font(face, fontWeight, fontStyle, underlined, strikethrough);


      TextEntity text_entity = new TextEntity
        {
          Plane = Plane.WorldXY,
          PlainText = content,
          Justification = TextJustification.MiddleCenter,
          Font = font
          };
      Rhino.DocObjects.DimensionStyle dimstyle = new Rhino.DocObjects.DimensionStyle();
      dimstyle.TextHeight = size;
      double smallCapsScale = 1;
      double spacing = 0;
      A = text_entity.CreateSurfaces(dimstyle, smallCapsScale, spacing);



    } else {

      Print("Some content is required.");

    }
# ---------- end c_script ----------
mesh = Mesh(c_script.A)
# String to Mesh
# Laurent Delrieu
# 03/03/2019
# 
# https://discourse.mcneel.com/t/creating-text-to-colored-mesh/79307/4
mesh_join = MeshJoin(Meshes=mesh)
move_4 = Move(Geometry=mesh_join, Motion=graft(vector))  # -> Geometry, Transform
move_5 = Move(Geometry=move_4.Geometry, Motion=vector_xyz.Vector)  # -> Geometry, Transform
mesh_edges = MeshEdges(Mesh=move_5.Geometry)  # -> NakedEdges, InteriorEdges, NonManifoldEdges
number_slider_9 = Slider(0.05, range=0..0.1)
colour_rgb = ColourRGB(Alpha=255, Red=54, Green=77, Blue=84)
unit_x_3 = UnitX(Factor="1000")
data_5 = Data(simplify(mesh_edges.NakedEdges))
data_6 = Data(tree_branch_2)
list_item_11 = ListItem(List=data_6, Index=9, Wrap=True)  # -> flatten(Item)
flatten_tree = FlattenTree(Tree=cull_index_6, Path="{0}")
join_curves = JoinCurves(Curves=data_5, Preserve=False)  # -> simplify(Curves)
panel = Panel(flatten_tree)

# ---- group: RH_OUT:Mass
data_7 = Data(list_item_11)

# ---- group: RH_OUT:Parameters
data_8 = Data(flatten_tree)

# ----
# Visualize grid points
number_slider_10 = Slider(0.04, range=0..0.1)
closest_point_3 = ClosestPoint(Point=deconstruct_mesh.Vertices, Cloud=construct_point)  # -> ClosestPoint, CPIndex, Distance
pull_point = PullPoint(Point=deconstruct_mesh.Vertices, Geometry=construct_point, ClosestOnly=True)  # -> ClosestPoint, Distance
list_length_2 = ListLength(List=pull_point.ClosestPoint)
range = Range(Domain=Domain(0, 1), Steps=expr("X-1", list_length_2))
list_item_12 = ListItem(List=remap_numbers_2.Mapped, Index=closest_point_3.CPIndex, Wrap=True)
unit_z_2 = UnitZ(Factor=list_item_12)
move_6 = Move(Geometry=pull_point.ClosestPoint, Motion=unit_z_2)  # -> Geometry, Transform
mesh_sphere_2 = MeshSphere(Base=move_6.Geometry, Radius=number_slider_10, UCount=10, VCount=20)

gradient_2 = Gradient(
    LowerLimit=0,
    UpperLimit=1,
    Parameter=range,
    stops=[0: RGB(205, 92, 92), 0: RGB(205, 92, 92), 0: RGB(114, 18, 103), 0.0912: RGB(184, 39, 96), 0.38: RGB(255, 215, 0), 0.627: RGB(25, 25, 112), 0.943: RGB(144, 238, 144), 1: RGB(0, 128, 0)])
reverse_list = ReverseList(List=gradient_2)

mcol_2 = MeshColours(Mesh=graft(mesh_sphere_2), Colours=graft(reverse_list))  # -> flatten(Mesh)

graft_tree = GraftTree(Tree=flatten(reverse_list), IncludeEmptyLists=True, IncludeNullItems=True)  # -> simplify(Tree)
custom_preview = CustomPreview(Geometry=data_5, Material=graft(reverse_list))

# ----
# Create Map
construct_point_5 = ConstructPoint(XCoordinate=cull_index_2, YCoordinate=cull_index_3, ZCoordinate=remap_numbers_2.Mapped)
partition_list = PartitionList(List=construct_point_5, Size=Slider(20, range=0..100))
settings_custom = SettingsCustom(
    StitchSeams=True,
    SimplePlanes=False,
    Refine=True,
    MinCount=16,
    MaxCount=400,
    AspectRatio=20,
    MaxDistance=0,
    MaxAngle=20,
    MinEdge=Slider(0.03, range=0..0.1),
    MaxEdge=0)
polyline = PolyLine(Vertices=partition_list, Closed=False)  # -> flatten(Polyline)
loft = Loft(Curves=polyline, Options={Adjust=False, Closed=False, LoftEnds=0, LoftSimp=0, LoftType=0, Rebuild=10, Refit=0.01})

# ---- group: Visualization of the map
mesh_brep = MeshBrep(Brep=loft, Settings=settings_custom)

# ----
quad_remesh = QuadRemesh(Mesh=mesh_brep, Settings={aqc=True, as=50, dhe=True, gci=0, null=False, pme=0, sa=0, tqc=2000})
deconstruct_mesh_3 = DeconstructMesh(Mesh=quad_remesh)  # -> Vertices, Faces, Colours, Normals
deconstruct = Deconstruct(Point=deconstruct_mesh_3.Vertices)  # -> XComponent, YComponent, ZComponent
gradient_3 = Gradient(LowerLimit=0, UpperLimit=0.5, Parameter=deconstruct.ZComponent, stops=[0: RGB(105, 105, 105), 0.652: RGB(220, 220, 220)])
mcol_3 = MeshColours(Mesh=quad_remesh, Colours=gradient_3)  # -> flatten(Mesh)

merge_3 = Merge(Data1=mcol_3, Data2=mcol, Data3=mcol_2)  # -> flatten(Result)
move_7 = Move(Geometry=merge_3, Motion=unit_x_3)  # -> Geometry, Transform

# ---- group: RH_OUT:OUT3
data_9 = Data(move_7.Geometry)

# ----
data_10 = Data(clean_tree)
list_item_13 = ListItem(List=data_10, Index=5, Wrap=True)  # -> Item, Item1
list_item_14 = ListItem(List=data_10, Index=7, Wrap=True)  # -> Item, Item1
list_item_15 = ListItem(List=data_10, Index=[0, 1, 2, 3, 4], Wrap=True)
subtraction_3 = Subtraction(A=1, B=list_item_14.Item1)
addition = Addition(A=Slider(1, range=0..4), B=subtraction_3)
unit_z_3 = UnitZ(Factor=Slider(1, range=0..1))
unit_z_4 = UnitZ(Factor=Slider(1, range=0.999..1))
unit_z_5 = UnitZ(Factor=list_item_14.Item1)
unit_z_6 = UnitZ(Factor=addition)
xy_plane = XYPlane(Origin=graft(merge_2))
move_8 = Move(Geometry=xy_plane, Motion=unit_z_3)  # -> Geometry, Transform
move_9 = Move(Geometry=move_8.Geometry, Motion=unit_z_4)  # -> Geometry, Transform
move_10 = Move(Geometry=move_9.Geometry, Motion=unit_z_5)  # -> Geometry, Transform
move_11 = Move(Geometry=move_10.Geometry, Motion=unit_z_6)  # -> Geometry, Transform
vector_xyz_2 = VectorXYZ(XComponent=0, YComponent=list_item_14.Item, ZComponent=Slider(0.5, range=0.1..0.8))  # -> Vector, Length
list_item_16 = ListItem(List=list_item_15, Index=0, Wrap=True)  # -> Item, Item1, Item2, Item3, Item4
move_12 = Move(Geometry=move_11.Geometry, Motion=vector_xyz_2.Vector)  # -> Geometry, Transform
circle = Circle(Plane=xy_plane, Radius=list_item_16.Item)
circle_2 = Circle(Plane=move_8.Geometry, Radius=list_item_16.Item1)
circle_3 = Circle(Plane=move_9.Geometry, Radius=list_item_16.Item2)
circle_4 = Circle(Plane=move_10.Geometry, Radius=list_item_16.Item3)
circle_5 = Circle(Plane=move_11.Geometry, Radius=list_item_16.Item4)
circle_6 = Circle(Plane=move_12.Geometry, Radius=Slider(4, range=0..10))
entwine_2 = Entwine(Branch00=circle, Branch01=circle_2, Branch02=circle_3, Branch03=circle_4, Branch04=circle_5, FlattenInputs=True)
divide_curve = DivideCurve(Curve=circle_6, Count=Slider(50, range=0..100), Kinks=False)  # -> Points, Tangents, Parameters
unit_z_7 = UnitZ(Factor=list_item_13.Item)
unit_z_8 = UnitZ(Factor=list_item_13.Item1)
panel_2 = Panel("""1
0
0
0
0
0
0
0
0
0""")
panel_3 = Panel("""0
0
0
0
1
0
1
0
0
0""")
divide_curve_2 = DivideCurve(Curve=entwine_2, Count=10, Kinks=False)  # -> Points, Tangents, Parameters
divide_curve_3 = DivideCurve(Curve=entwine_2, Count=Slider(5, range=0..10), Kinks=False)  # -> Points, Tangents, Parameters
panel_4 = Panel("""0
0
0
0
0
1
0
0
0
0""")
sift_pattern = SiftPattern(List=divide_curve.Points, SiftPattern=panel_2)  # -> Output0, Output1
sift_pattern_2 = SiftPattern(List=divide_curve.Points, SiftPattern=panel_3)  # -> Output0, Output1
sift_pattern_3 = SiftPattern(List=divide_curve.Points, SiftPattern=panel_4)  # -> Output0, Output1
polyline_2 = PolyLine(Vertices=divide_curve_2.Points, Closed=True)
move_13 = Move(Geometry=sift_pattern.Output1, Motion=unit_z_7)  # -> Geometry, Transform
move_14 = Move(Geometry=sift_pattern_3.Output1, Motion=unit_z_8)  # -> Geometry, Transform
explode = Explode(Curve=polyline_2, Recursive=True)  # -> Segments, Vertices
clean_tree_2 = CleanTree(RemoveNulls=True, RemoveInvalid=True, RemoveEmpty=False, Tree=move_13.Geometry)  # -> graft(Tree)
clean_tree_3 = CleanTree(RemoveNulls=True, RemoveInvalid=True, RemoveEmpty=False, Tree=sift_pattern_2.Output1)
clean_tree_4 = CleanTree(RemoveNulls=True, RemoveInvalid=True, RemoveEmpty=False, Tree=move_14.Geometry)
number_slider_11 = Slider(4, range=0..10)
number_slider_12 = Slider(1, range=0..10)
number_slider_13 = Slider(5, range=0..10)
number_slider_14 = Slider(1, range=0..10)

trim_tree_2 = TrimTree(Tree=divide_curve_3.Points, Depth=1)
trim_tree_3 = TrimTree(Tree=explode.Segments, Depth=2)

flip_matrix_5 = FlipMatrix(Data=trim_tree_2)
polyline_3 = PolyLine(Vertices=flip_matrix_5, Closed=False)
explode_2 = Explode(Curve=polyline_3, Recursive=True)  # -> Segments, Vertices
flip_matrix_6 = FlipMatrix(Data=trim_tree_3)
list_item_17 = ListItem(List=explode_2.Vertices, Index=4, Wrap=True)
list_item_18 = ListItem(List=flip_matrix_6, Index=4, Wrap=True)
line = Line(StartPoint=list_item_17, EndPoint=clean_tree_2)
end_points = EndPoints(Curve=list_item_18)  # -> Start, End

trim_tree_4 = TrimTree(Tree=end_points.End, Depth=1)

geometry = Geometry(polyline_3)
geometry_2 = Geometry(explode.Segments)
geometry_3 = Geometry(line)

partition_list_2 = PartitionList(List=flatten(geometry), Size=5)  # -> simplify(Chunks)

dispatch = Dispatch(List=trim_tree_4, DispatchPattern=[True, False])  # -> graft(ListA), ListB
duplicate_data = DuplicateData(Data=dispatch.ListA, Number=2, Order=True)
line_2 = Line(StartPoint=graft(clean_tree_4), EndPoint=dispatch.ListA)
shift_list = ShiftList(List=partition_list_2, Shift=1, Wrap=True)  # -> simplify(List)
ruled_surface = RuledSurface(CurveA=partition_list_2, CurveB=shift_list)
point_on_curve = PointOnCurve(geometry_3, parameter=0.25)

trim_tree_5 = TrimTree(Tree=duplicate_data, Depth=2)
partition_list_3 = PartitionList(List=trim_tree_5, Size=10)
panel_5 = Panel(partition_list_3)

# ---- group: Column
braced_grid_2_d_structure = BracedGrid2DStructure(Surface=ruled_surface, UDivisions=number_slider_13, VDivisions=number_slider_14)  # -> PrimaryLines, BraceLines, StructureNodes
braced_grid_1_d_structure = BracedGrid1DStructure(Surface=ruled_surface, UDivisions=number_slider_13, VDivisions=number_slider_14)  # -> PrimaryLines, BraceLines, StructureNodes

# ----
line_3 = Line(StartPoint=clean_tree_3, EndPoint=partition_list_3)
dispatch_2 = Dispatch(List=line_3, DispatchPattern=[True, False])  # -> ListA, ListB
shift_list_2 = ShiftList(List=dispatch_2.ListB, Shift=Slider(4, range=0..10), Wrap=True)
entwine_3 = Entwine(Branch00=geometry_3, Branch01=shift_list_2, FlattenInputs=True)
entwine_4 = Entwine(Branch00=geometry_3, Branch01=dispatch_2.ListA, FlattenInputs=True)
entwine_5 = Entwine(Branch00=dispatch_2.ListA, Branch01=line_2, FlattenInputs=True)
entwine_6 = Entwine(Branch00=dispatch_2.ListB, Branch01=line_2, FlattenInputs=True)
flip_matrix_7 = FlipMatrix(Data=entwine_3)
flip_matrix_8 = FlipMatrix(Data=entwine_4)
flip_matrix_9 = FlipMatrix(Data=entwine_5)
flip_matrix_10 = FlipMatrix(Data=entwine_6)
loft_2 = Loft(Curves=flip_matrix_7, Options={Adjust=True, Closed=False, LoftEnds=0, LoftSimp=1, LoftType=0, Rebuild=10, Refit=0.01})
loft_3 = Loft(Curves=flip_matrix_8, Options={Adjust=True, Closed=False, LoftEnds=0, LoftSimp=1, LoftType=0, Rebuild=10, Refit=0.01})
loft_4 = Loft(Curves=flip_matrix_9, Options={Adjust=True, Closed=False, LoftEnds=0, LoftSimp=1, LoftType=0, Rebuild=10, Refit=0.01})
loft_5 = Loft(Curves=flip_matrix_10, Options={Adjust=True, Closed=False, LoftEnds=0, LoftSimp=1, LoftType=0, Rebuild=10, Refit=0.01})
list_item_19 = ListItem(List=braced_grid_2_d_structure.PrimaryLines, Index=Slider(15, range=0..100), Wrap=True)
list_item_20 = ListItem(List=braced_grid_2_d_structure.StructureNodes, Index=15, Wrap=True)  # -> simplify(Item)

# ---- group: Roof
braced_grid_1_d_structure_2 = BracedGrid1DStructure(Surface=[loft_2, loft_3], UDivisions=Slider(1, range=0..10), VDivisions=number_slider_11)  # -> PrimaryLines, BraceLines, StructureNodes
braced_grid_1_d_structure_3 = BracedGrid1DStructure(Surface=[loft_4, loft_5], UDivisions=Slider(1, range=0..1), VDivisions=number_slider_11)  # -> PrimaryLines, BraceLines, StructureNodes

# ----
end_points_2 = EndPoints(Curve=list_item_19)  # -> Start, End
trim_tree_6 = TrimTree(Tree=end_points_2.Start, Depth=1)
trim_tree_7 = TrimTree(Tree=list_item_20, Depth=1)  # -> simplify(Tree)
polyline_4 = PolyLine(Vertices=trim_tree_6, Closed=True)

polygon_center = PolygonCenter(Polyline=polyline_4)  # -> CenterV, CenterE, CenterA
line_4 = Line(StartPoint=polygon_center.CenterV, EndPoint=trim_tree_7)

sort_points = SortPoints(Points=polygon_center.CenterV)  # -> simplify(graft(Points)), Indices
geometry_4 = Geometry(simplify(line_4))

# ---- group: All elements
curve = Curve(simplify(braced_grid_1_d_structure_2.PrimaryLines))
curve_2 = Curve(braced_grid_1_d_structure_2.BraceLines)
curve_3 = Curve(braced_grid_1_d_structure_3.PrimaryLines)
curve_4 = Curve(braced_grid_1_d_structure_3.BraceLines)
curve_5 = Curve(braced_grid_1_d_structure.PrimaryLines)
curve_6 = Curve(braced_grid_1_d_structure.BraceLines)

# ----
list_item_21 = ListItem(List=curve_5, Index=Slider(9, range=0..10), Wrap=True)
end_points_3 = EndPoints(Curve=list_item_21)  # -> Start, End

# ---- group: All elements (continued)
line_5 = Line(StartPoint=end_points_3.End, EndPoint=point_on_curve)  # -> simplify(Line)

# ----
partition_list_4 = PartitionList(List=flatten(curve), Size=130)  # -> simplify(Chunks)
partition_list_5 = PartitionList(List=flatten(curve_2), Size=40)  # -> simplify(Chunks)
partition_list_6 = PartitionList(List=flatten(curve_3), Size=130)  # -> simplify(Chunks)
partition_list_7 = PartitionList(List=flatten(curve_5), Size=80)  # -> simplify(Chunks)
partition_list_8 = PartitionList(List=flatten(curve_6), Size=25)  # -> simplify(Chunks)
trim_tree_8 = TrimTree(Tree=line_5, Depth=1)
merge_4 = Merge(
    Data1=simplify(partition_list_4),
    Data2=simplify(geometry_4),
    Data3=simplify(partition_list_5),
    Data4=partition_list_6,
    Data5=partition_list_7,
    Data6=partition_list_8,
    Data7=trim_tree_8)

split_tree = SplitTree(Data=merge_4, Masks=flatten("{0}"))  # -> Positive, Negative
join_curves_2 = JoinCurves(Curves=split_tree.Negative, Preserve=False)  # -> simplify(Curves)
c_script_2 = CSharpScript(crv=split_tree.Positive, color=graft(colour_rgb))  # -> out, flatten(A); inputs crv: Curve, color: Color
# ---------- c_script_2: C# ----------
    var c = color.R + "," + color.G + "," + color.B;
    crv.SetUserString("color", c);
    A = crv;
# ---------- end c_script_2 ----------
c_script_3 = CSharpScript(crv=join_curves_2, color=graft(reverse_list))  # -> out, flatten(A); inputs crv: Curve, color: Color; same code as c_script_2
renumber_paths = RenumberPaths(Data=join_curves_2)

# ---- group: RH_OUT:OUT1
curve_7 = Curve(c_script_2.A)

# ---- group: RH_OUT:OUT2
curve_8 = Curve(c_script_3.A)

# ----
merge_5 = Merge(Data1=renumber_paths, Data2=join_curves)
custom_preview_2 = CustomPreview(Geometry=join_curves_2, Material=graft(reverse_list))
panel_6 = Panel(curve_7)
