# Grasshopper definition AJ_Canopy_DatasetGeneration.gh (Grasshopper 1.0.7)
# plug-ins: LunchBox, karambaGH, Weaverbird

number_of_samples_divided_by_4 = Slider(2000, range=0..3000)

# ----
# ANIMATE THIS SLIDER
number_slider = Slider(0, range=0..1999)

seed = Slider(0, range=0..10)
python = GhPythonScript(x=number_of_samples_divided_by_4, y=seed)  # -> out, a; inputs x: Int32, y: Int32
# ---------- python: Python ----------
__author__ = "garo"
__version__ = "2021.04.26"

import Rhino.Geometry as rg
import random

paramList =[]
import ghpythonlib.treehelpers as th    

for j in range(x):
    subList = []
    #Column radius
    for i in range(5):
        subList.append(random.uniform(0.1,1))
    #Roof Control points Z coordinates
    subList.append(random.uniform(-1,1))
    subList.append(random.uniform(-0.5,0.5))
    #Shift
    subList.append(random.uniform(0,1.5))
    #Kicker elevation
    subList.append(random.uniform(0,1))
    paramList.append(subList)
 
#
a = th.list_to_tree(paramList)
# ---------- end python ----------
concat = Concatenate(FragmentA="{", FragmentB=number_slider, FragmentA_2="}")
simplify = SimplifyTree(Tree=python.a, Front=False)
branch = TreeBranch(Tree=simplify, Path=concat, MaintainPaths=True)
panel = Panel(python.a)
panel_2 = Panel(branch)
list_item = ListItem(List=branch, Index=[0, 1, 2, 3, 4], Wrap=True)
list_item_2 = ListItem(List=branch, Index=5, Wrap=True)  # -> Item, Item1
list_item_3 = ListItem(List=branch, Index=7, Wrap=True)  # -> Item, Item1

# ---- group: Roof control points Z coord
number_slider_2 = Slider(0.556, range=-1..1)
number_slider_3 = Slider(0.147, range=-0.25..0.25)

# ---- group: Shift
number_slider_4 = Slider(1.1, range=0..1.5)

# ---- group: Ki elevation
number_slider_5 = Slider(1, range=0..1)

# ---- group: Column Radius
gene_pool = GenePool(Decimals=1, Maximum=1, Minimum=0.2, Value=[0.7, 0.8, 0.5, 0.3, 0.7])

# ---- group: writer / compile dataset
panel_3 = Panel("PATH")

# ----
subtraction = Subtraction(A=1, B=list_item_3.Item1)
addition = Addition(A=Slider(1, range=0..4), B=subtraction)
unit_z = UnitZ(Factor=Slider(1, range=0..1))
unit_z_2 = UnitZ(Factor=Slider(1, range=0.999..1))
unit_z_3 = UnitZ(Factor=list_item_3.Item1)
unit_z_4 = UnitZ(Factor=addition)
xy_plane = XYPlane(Origin=Point(0, 0, 0))
move = Move(Geometry=xy_plane, Motion=unit_z)  # -> Geometry, Transform
move_2 = Move(Geometry=move.Geometry, Motion=unit_z_2)  # -> Geometry, Transform
move_3 = Move(Geometry=move_2.Geometry, Motion=unit_z_3)  # -> Geometry, Transform
move_4 = Move(Geometry=move_3.Geometry, Motion=unit_z_4)  # -> Geometry, Transform
vector_xyz = VectorXYZ(XComponent=0, YComponent=list_item_3.Item, ZComponent=Slider(0.5, range=0.1..0.8))  # -> Vector, Length
list_item_4 = ListItem(List=list_item, Index=0, Wrap=True)  # -> Item, Item1, Item2, Item3, Item4
move_5 = Move(Geometry=move_4.Geometry, Motion=vector_xyz.Vector)  # -> Geometry, Transform
circle = Circle(Plane=xy_plane, Radius=list_item_4.Item)
circle_2 = Circle(Plane=move.Geometry, Radius=list_item_4.Item1)
circle_3 = Circle(Plane=move_2.Geometry, Radius=list_item_4.Item2)
circle_4 = Circle(Plane=move_3.Geometry, Radius=list_item_4.Item3)
circle_5 = Circle(Plane=move_4.Geometry, Radius=list_item_4.Item4)
circle_6 = Circle(Plane=move_5.Geometry, Radius=Slider(4, range=0..10))
entwine = Entwine(Branch00=circle, Branch01=circle_2, Branch02=circle_3, Branch03=circle_4, Branch04=circle_5, FlattenInputs=True)
divide_curve = DivideCurve(Curve=circle_6, Count=Slider(50, range=0..100), Kinks=False)  # -> Points, Tangents, Parameters
unit_z_5 = UnitZ(Factor=list_item_2.Item)
unit_z_6 = UnitZ(Factor=list_item_2.Item1)
panel_4 = Panel("""1
0
0
0
0
0
0
0
0
0""")
panel_5 = Panel("""0
0
0
0
1
0
1
0
0
0""")
divide_curve_2 = DivideCurve(Curve=entwine, Count=10, Kinks=False)  # -> Points, Tangents, Parameters
divide_curve_3 = DivideCurve(Curve=entwine, Count=Slider(5, range=0..10), Kinks=False)  # -> Points, Tangents, Parameters
panel_6 = Panel("""0
0
0
0
0
1
0
0
0
0""")
flip_matrix = FlipMatrix(Data=divide_curve_3.Points)
sift_pattern = SiftPattern(List=divide_curve.Points, SiftPattern=panel_4)  # -> Output0, Output1
sift_pattern_2 = SiftPattern(List=divide_curve.Points, SiftPattern=panel_5)  # -> Output0, Output1
sift_pattern_3 = SiftPattern(List=divide_curve.Points, SiftPattern=panel_6)  # -> Output0, Output1
polyline = PolyLine(Vertices=divide_curve_2.Points, Closed=True)
polyline_2 = PolyLine(Vertices=flip_matrix, Closed=False)
move_6 = Move(Geometry=sift_pattern.Output1, Motion=unit_z_5)  # -> Geometry, Transform
move_7 = Move(Geometry=sift_pattern_3.Output1, Motion=unit_z_6)  # -> Geometry, Transform
explode = Explode(Curve=polyline, Recursive=True)  # -> Segments, Vertices
explode_2 = Explode(Curve=polyline_2, Recursive=True)  # -> Segments, Vertices
flip_matrix_2 = FlipMatrix(Data=explode.Segments)
clean_tree = CleanTree(RemoveNulls=True, RemoveInvalid=True, RemoveEmpty=False, Tree=move_6.Geometry)  # -> graft(Tree)
clean_tree_2 = CleanTree(RemoveNulls=True, RemoveInvalid=True, RemoveEmpty=False, Tree=sift_pattern_2.Output1)
clean_tree_3 = CleanTree(RemoveNulls=True, RemoveInvalid=True, RemoveEmpty=False, Tree=move_7.Geometry)
list_item_5 = ListItem(List=explode_2.Vertices, Index=4, Wrap=True)
list_item_6 = ListItem(List=flip_matrix_2, Index=4, Wrap=True)
line = Line(StartPoint=list_item_5, EndPoint=clean_tree)
end_points = EndPoints(Curve=list_item_6)  # -> flatten(Start), flatten(End)
dispatch = Dispatch(List=end_points.End, DispatchPattern=[True, False])  # -> graft(ListA), ListB
duplicate_data = DuplicateData(Data=dispatch.ListA, Number=2, Order=True)  # -> flatten(Data)
line_2 = Line(StartPoint=graft(clean_tree_3), EndPoint=dispatch.ListA)
line_3 = Line(StartPoint=clean_tree_2, EndPoint=duplicate_data)
dispatch_2 = Dispatch(List=line_3, DispatchPattern=[True, False])  # -> ListA, ListB
entwine_2 = Entwine(Branch00=dispatch_2.ListA, Branch01=line_2, FlattenInputs=True)
entwine_3 = Entwine(Branch00=dispatch_2.ListB, Branch01=line_2, FlattenInputs=True)
flip_matrix_3 = FlipMatrix(Data=entwine_2)
flip_matrix_4 = FlipMatrix(Data=entwine_3)
loft = Loft(Curves=flip_matrix_3, Options={Adjust=True, Closed=False, LoftEnds=0, LoftSimp=1, LoftType=0, Rebuild=10, Refit=0.01})
loft_2 = Loft(Curves=flip_matrix_4, Options={Adjust=True, Closed=False, LoftEnds=0, LoftSimp=1, LoftType=0, Rebuild=10, Refit=0.01})
number_slider_6 = Slider(1, range=0..10)
number_slider_7 = Slider(5, range=0..10)
number_slider_8 = Slider(1, range=0..10)
number_slider_9 = Slider(4, range=0..10)

# ---- group: Column
geometry = Geometry(explode_2.Segments)

# ---- group: Column tie
geometry_2 = Geometry(explode.Segments)

# ---- group: Girder
geometry_3 = Geometry(line)

# ----
shift_list = ShiftList(List=flatten(geometry_3), Shift=Slider(1, range=0..10), Wrap=True)
entwine_4 = Entwine(Branch00=shift_list, Branch01=dispatch_2.ListB, FlattenInputs=True)
entwine_5 = Entwine(Branch00=geometry_3, Branch01=dispatch_2.ListA, FlattenInputs=True)
flip_matrix_5 = FlipMatrix(Data=entwine_4)
flip_matrix_6 = FlipMatrix(Data=entwine_5)
loft_3 = Loft(Curves=flip_matrix_5, Options={Adjust=True, Closed=False, LoftEnds=0, LoftSimp=1, LoftType=0, Rebuild=10, Refit=0.01})
loft_4 = Loft(Curves=flip_matrix_6, Options={Adjust=True, Closed=False, LoftEnds=0, LoftSimp=1, LoftType=0, Rebuild=10, Refit=0.01})
join_curves = JoinCurves(Curves=geometry, Preserve=False)  # -> flatten(Curves)
shift_list_2 = ShiftList(List=join_curves, Shift=1, Wrap=True)
ruled_surface = RuledSurface(CurveA=join_curves, CurveB=shift_list_2)
point_on_curve = PointOnCurve(geometry_3, parameter=0.25)

# ---- group: Roof
braced_grid_1_d_structure = BracedGrid1DStructure(Surface=flatten([loft_3, loft_4]), UDivisions=Slider(1, range=0..10), VDivisions=number_slider_9)  # -> PrimaryLines, BraceLines, StructureNodes
braced_grid_1_d_structure_2 = BracedGrid1DStructure(Surface=flatten([loft, loft_2]), UDivisions=Slider(1, range=0..1), VDivisions=number_slider_9)  # -> PrimaryLines, BraceLines, StructureNodes

# ---- group: Column
braced_grid_1_d_structure_3 = BracedGrid1DStructure(Surface=flatten(ruled_surface), UDivisions=number_slider_7, VDivisions=number_slider_8)  # -> PrimaryLines, BraceLines, StructureNodes
braced_grid_2_d_structure = BracedGrid2DStructure(Surface=ruled_surface, UDivisions=number_slider_7, VDivisions=number_slider_8)  # -> PrimaryLines, BraceLines, StructureNodes

# ----
list_item_7 = ListItem(List=braced_grid_2_d_structure.PrimaryLines, Index=15, Wrap=True)
join_curves_2 = JoinCurves(Curves=flatten(list_item_7), Preserve=False)
list_item_8 = ListItem(List=braced_grid_2_d_structure.StructureNodes, Index=15, Wrap=True)
polygon_center = PolygonCenter(Polyline=join_curves_2)  # -> CenterV, CenterE, CenterA
line_4 = Line(StartPoint=list_item_8, EndPoint=polygon_center.CenterV)

# ---- group: All elements
curve = Curve([braced_grid_1_d_structure.PrimaryLines, line_4])
curve_2 = Curve(braced_grid_1_d_structure.BraceLines)
curve_3 = Curve(braced_grid_1_d_structure_2.PrimaryLines)
curve_4 = Curve(braced_grid_1_d_structure_2.BraceLines)
curve_5 = Curve(braced_grid_1_d_structure_3.PrimaryLines)
curve_6 = Curve(braced_grid_1_d_structure_3.BraceLines)

# ----
list_item_9 = ListItem(List=curve_5, Index=Slider(9, range=0..10), Wrap=True)
end_points_2 = EndPoints(Curve=list_item_9)  # -> Start, End

# ---- group: All elements (continued)
line_5 = Line(StartPoint=end_points_2.End, EndPoint=point_on_curve)

# ----
entwine_6 = Entwine(
    Branch00=curve,
    Branch01=curve_2,
    Branch02=curve_3,
    Branch03=curve_4,
    Branch04=curve_5,
    Branch05=curve_6,
    Branch06=line_5,
    FlattenInputs=True)
end_points_3 = EndPoints(Curve=entwine_6)  # -> Start, End
line_6 = Line(StartPoint=end_points_3.Start, EndPoint=end_points_3.End)

# ----
# STRUCTURAL SIMULATION
panel_7 = Panel("""RoofBrace
RoofBrace
ColumnBrace
Kicker""")
weaverbird_s_mesh_from_lines_weave_back = WeaverbirdsMeshFromLinesWeaveBack(
    Lines=flatten([braced_grid_1_d_structure.PrimaryLines, braced_grid_1_d_structure.BraceLines, braced_grid_1_d_structure_2.PrimaryLines, braced_grid_1_d_structure_2.BraceLines, line_4]),
    MaximumValence=4)
beam_joints_karamba3d = BeamJointsKaramba3D(
    ElementIdentifiers=panel_7,
    CtKNMAtStartingNode=Vector(0, 0, 0),
    CrKNmRadAtStartingNode=Vector(0, 0, 0),
    CtKNMAtEndNode=Vector(0, 0, 0),
    CrKNmRadAtEndNode=Vector(0, 0, 0),
    menu=[buttons(off, off, off, off, on, on), buttons(off, off, off, on, on, on)])
list_item_10 = ListItem(List=curve_5, Index=0, Wrap=True)
line_line_intersection_karamba3d = LineLineIntersectionKaramba3D(Line=line_6, LimitDistance_m=0.005)  # -> IntersectionPoints, LineSubSegements
mesh_edges = MeshEdges(Mesh=weaverbird_s_mesh_from_lines_weave_back)  # -> NakedEdges, InteriorEdges, NonManifoldEdges
panel_8 = Panel("""RoofMain
RoofBrace
RoofMain
RoofBrace
Column
ColumnBrace
Kicker""")
trim_tree = TrimTree(Tree=line_line_intersection_karamba3d.LineSubSegements, Depth=1)  # -> simplify(Tree)
end_points_4 = EndPoints(Curve=list_item_10)  # -> Start, End
panel_9 = Panel("""RoofBrace
ColumnBrace""")
unit_z_7 = UnitZ(Factor=Slider(-2, range=-5..10))
unit_z_8 = UnitZ(Factor="-1")
list_length = ListLength(List=trim_tree)
point = Point(flatten(end_points_4.Start))
material_selection_karamba3d = MaterialSelectionKaramba3D(menu=[dropdown(1), dropdown(2)])
cross_section_range_selector_karamba3d = CrossSectionRangeSelectorKaramba3D(MaximumHeight_cm=-1, MaximumWidth_cm=-1, ElementsIdentifiers="Column", menu=[dropdown(1), dropdown(3), dropdown(8)])
cross_section_range_selector_karamba3d_2 = CrossSectionRangeSelectorKaramba3D(MaximumHeight_cm=-1, MaximumWidth_cm=-1, ElementsIdentifiers="RoofMain", menu=[dropdown(1), dropdown(3), dropdown(8)])
cross_section_range_selector_karamba3d_3 = CrossSectionRangeSelectorKaramba3D(MaximumHeight_cm=-1, MaximumWidth_cm=-1, ElementsIdentifiers=panel_9, menu=[dropdown(1), dropdown(3), dropdown(8)])
support_karamba3d = SupportKaramba3D(PosInd=point, menu=[buttons(on, on, on, on, on, on)])
repeat_data = RepeatData(Data=graft(panel_8), Length=list_length)  # -> flatten(Data)
line_to_beam_karamba3d = LineToBeamKaramba3D(Line=flatten(trim_tree), Identifier=repeat_data, New=True, Remove=True, LimitDistance_m=0.005)  # -> flatten(Element), flatten(Points), Info
loads_karamba3d = LoadsKaramba3D(
    Vector=unit_z_7,
    Mesh=weaverbird_s_mesh_from_lines_weave_back,
    LCase="1",
    mode="MeshLoad -Const.",
    menu=[buttons(off, on, off), buttons(on, on)])
loads_karamba3d_2 = LoadsKaramba3D(Vector=unit_z_8, LCase="0", mode="Gravity")
list_item_11 = ListItem(List=cross_section_range_selector_karamba3d, Index=Slider(626, range=0..1000), Wrap=True)
list_item_12 = ListItem(List=cross_section_range_selector_karamba3d_2, Index=Slider(186, range=0..1000), Wrap=True)
list_item_13 = ListItem(List=cross_section_range_selector_karamba3d_3, Index=Slider(61, range=0..1000), Wrap=True)
panel_10 = Panel(line_to_beam_karamba3d.Element)
panel_11 = Panel("""S_RoofMain
S_RoofBrace
S_RoofMain
S_RoofBrace
S_Column
S_ColumnBrace
S_Kicker""")
panel_12 = Panel("""red
blue
green
magenta
cyan
black
grey""")
make_element_set_karamba3d = MakeElementSetKaramba3D(ElementIdentifiers=panel_8, SetIdentifier=panel_11, MinimumSplitLength_m=0.001, ColorOfTheSet=panel_12)
assemble_model_karamba3d = AssembleModelKaramba3D(
    Elem=flatten(line_to_beam_karamba3d.Element),
    Support=flatten(support_karamba3d),
    Load=flatten([loads_karamba3d_2, loads_karamba3d]),
    CrossSection=flatten([list_item_12, list_item_13, list_item_11]),
    Material=flatten(material_selection_karamba3d),
    Joint=flatten(beam_joints_karamba3d),
    BeamSet=flatten(make_element_set_karamba3d),
    LimitDistance_m=0.005)  # -> Model, Info, Mass_kg, CenterOfGravity
analyze_karamba3d = AnalyzeKaramba3D(Model=assemble_model_karamba3d.Model)  # -> CalculatedModel, MaximumDisplacement_cm, ResultingForceOfGravity_kN, ElasticEnergy_kNm
optimize_cross_section_karamba3d = OptimizeCrossSectionKaramba3D(
    Model=analyze_karamba3d.CalculatedModel,
    ElemIdentifiers=panel_8,
    GroupIdentifiers=panel_11,
    CrossSections=cross_section_range_selector_karamba3d_2,
    MaximumUtilization=Slider(0.95, range=0..1),
    MaximumDisplacement_cm=-1,
    UltimateLimitStateIterations=5,
    DisplacementIterations=5,
    NumberOfSamplePoints=3,
    ElasticDesign=True,
    GammaM0=1,
    GammaM1=1)  # -> ModelWithOptimizedCrossSections, Info, Mass_kg, MaximumDisplacement_cm, ElasticEnergy_kNm
model_view_karamba3d = ModelViewKaramba3D(Model=optimize_cross_section_karamba3d.ModelWithOptimizedCrossSections, ResultFactors=1, ResultCase=-1)  # -> Model, DeformedMesh, DeformedAxes, DeformedModel
panel_13 = Panel(optimize_cross_section_karamba3d.ModelWithOptimizedCrossSections)
beam_view_karamba3d = BeamViewKaramba3D(Model=model_view_karamba3d.Model)  # -> Model, MeshesOfRenderedBeams, DeformedBeamAxes, LegendColors, LegendTags
beam_forces_karamba3d = BeamForcesKaramba3D(AnalyzedModel=beam_view_karamba3d.Model, LCase=-1, MaximumDistanceBetweenResults_m=-1, NumberOfResultsPerBeamElement=2)  # -> AnalyzedModel, simplify(NormalForce_kN), ShearForceVz_kN, ShearForceVy_kN, BendingMomentMt_kNm, BendingMomentMy_kNm, BendingMomentMz_kNm
legend = Legend(Colour=beam_view_karamba3d.LegendColors, Tags=beam_view_karamba3d.LegendTags, LegendType=1)
deformation_energy_karamba3d = DeformationEnergyKaramba3D(AnalyzedModel=beam_view_karamba3d.Model, ResultCase=0)  # -> AnalyzedModel, AxialDeformationEnergies_kNm, BendingEnergies_kNm
panel_14 = Panel(beam_forces_karamba3d.NormalForce_kN)

# ----
# WRITE TO FILE
sort_list = SortList(Keys=optimize_cross_section_karamba3d.MaximumDisplacement_cm)  # -> Keys, ValuesValuesA
sort_list_2 = SortList(Keys=optimize_cross_section_karamba3d.ElasticEnergy_kNm)  # -> Keys, ValuesValuesA
list_item_14 = ListItem(List=sort_list.Keys, Index=0, Wrap=True)  # -> Item1, Item
list_item_15 = ListItem(List=sort_list_2.Keys, Index=0, Wrap=True)  # -> Item1, Item
merge = Merge(Data1=optimize_cross_section_karamba3d.Mass_kg, Data2=list_item_14.Item1, Data3=list_item_15.Item1)
panel_15 = Panel("""columnR1
columnR2
columnR3
columnR4
columnR5
roofControl1
roofControl2
shift
kickerElev""")
panel_16 = Panel("""mass
maxDispl
elasticEnergy""")
merge_2 = Merge(Data1=flatten(branch), Data2=flatten(merge))
merge_3 = Merge(Data1=flatten(panel_15), Data2=flatten(panel_16))
panel_17 = Panel(merge_2)
panel_18 = Panel(merge_3)

# ---- group: writer
num = Number(number_slider)
join = TextJoin(Text=merge_2, Join=" ")
join_2 = TextJoin(Text=merge_3, Join=" ")
num_2 = Number(num)
export_robotmotion_3_r3_multi = PythonScript(toggle=Toggle(True), path=panel_3, x=join, labs=join_2, y=num_2)
# ---------- export_robotmotion_3_r3_multi: Python ----------
#script by Gabriella Rossi / CITA
import os
from os import listdir
from os.path import isfile, join
from scriptcontext import sticky as st

if True:
    #Create file
    filename = str(path)
    fil = open(filename, 'a+')
    
    if y < 1 :

        #write header and first line
        fil.write(labs)
        fil.write('\n' + x)
    else:
        #just write line
        fil.write('\n' + x)

    fil.close()
# ---------- end export_robotmotion_3_r3_multi ----------
