# Grasshopper definition vae.gh (Grasshopper 1.0.7)
# plug-ins: Hops, LunchBox, Heteroptera, treesloth01

# ---- group: INPUTS
data = Data()

# ----
data_2 = Data()

# ----
# Load the latent
# space points
hops = Hops(
    CacheResultsInMemory=False,
    CacheSolveResults=False,
    RemoteDefinitionLocation="http://127.0.0.1:5000/encoder",
    RemoteSolveVersion=(0, 1, 0),
    ShowInput_Enabled=False,
    ShowInput_Path=False,
    SynchronousSolve=True)  # -> Z1, Z2

# ----
# Visualize points
construct_point = ConstructPoint(XCoordinate=hops.Z1, YCoordinate=hops.Z2, ZCoordinate=0)
cloud_display = CloudDisplay(Points=construct_point, Colours=ColourSwatch(SwatchColor=RGBA(132, 228, 62, 110)), Size=0.05, SpriteType=0)

# ----
# Coordinates in the latent space
# mapped from 0 to 1
number_slider = Slider(1, range=0..1)

# ----
# Numbers for grid division
number_slider_2 = Slider(3, range=0..10)
number_slider_3 = Slider(3, range=0..10)

# ----
# Create a grid of points
# in the latent space
sort_list = SortList(Keys=hops.Z1)  # -> Keys, ValuesValuesA
sort_list_2 = SortList(Keys=hops.Z2)  # -> Keys, ValuesValuesA
list_item = ListItem(List=sort_list.Keys, Index=0, Wrap=True)  # -> Item1, Item
list_item_2 = ListItem(List=sort_list_2.Keys, Index=0, Wrap=True)  # -> Item1, Item
construct_domain = ConstructDomain(DomainStart=list_item.Item, DomainEnd=list_item.Item1)
construct_domain_2 = ConstructDomain(DomainStart=list_item_2.Item, DomainEnd=list_item_2.Item1)
subtraction = Subtraction(A=list_item.Item1, B=list_item.Item)
subtraction_2 = Subtraction(A=list_item_2.Item1, B=list_item_2.Item)
rectangle = Rectangle(Plane=PlaneXY(0, 0, 0), XSize=construct_domain, YSize=construct_domain_2, Radius=0)  # -> Rectangle, Length
division = Division(A=subtraction, B=number_slider_2)
division_2 = Division(A=subtraction_2, B=number_slider_3)
rectangle_grid = RectangleGrid(Rectangle=rectangle.Rectangle, Size=division, VSize=division_2, FitSize=True)  # -> flatten(Points), U, V

# ----
# Visualize moving point
remap_numbers = RemapNumbers(Value=number_slider, Source=Domain(0, 1), Target=construct_domain)  # -> Mapped, Clipped
remap_numbers_2 = RemapNumbers(Value=Slider(0.445, range=0..1), Source=Domain(0, 1), Target=construct_domain_2)  # -> Mapped, Clipped
construct_point_2 = ConstructPoint(XCoordinate=remap_numbers.Mapped, YCoordinate=remap_numbers_2.Mapped, ZCoordinate=0)
circle = Circle(Plane=construct_point_2, Radius=Slider(0.04, range=0..0.1))
colour_swatch = ColourSwatch(SwatchColor=RGB(16, 0, 255))
boundary_surfaces = BoundarySurfaces(Edges=circle)
custom_preview = CustomPreview(Geometry=boundary_surfaces, Material=colour_swatch)

# ----
# Visualize grid points
list_length = ListLength(List=rectangle_grid.Points)
range = Range(Domain=Domain(0, 1), Steps=expr("X-1", list_length))
circle_2 = Circle(Plane=rectangle_grid.Points, Radius=Slider(0.04, range=0..0.1))
gradient = Gradient(
    LowerLimit=0,
    UpperLimit=1,
    Parameter=range,
    stops=[0: RGB(210, 0, 118), 0: RGB(103, 0, 120), 0: RGB(79, 186, 8), 0: RGB(243, 57, 0), 0: RGB(129, 57, 70), 0: RGB(220, 237, 32), 0: RGB(243, 57, 0), 0.00304: RGB(210, 15, 142), 0.00539: RGB(236, 27, 60), 0.247: RGB(39, 72, 161)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])
boundary_surfaces_2 = BoundarySurfaces(Edges=circle_2)
custom_preview_2 = CustomPreview(Geometry=boundary_surfaces_2, Material=gradient)

# ----
# Create a grid for samples
number_slider_4 = Slider(15, range=0..15)
construct_point_3 = ConstructPoint(XCoordinate=10, YCoordinate=0, ZCoordinate=0)
rectangle_2 = Rectangle(Plane=PlaneXY(0, 0, 0), XSize=number_slider_4, YSize=number_slider_4, Radius=0)  # -> Rectangle, Length
unit_x = UnitX(Factor=-20)
rectangular_array = RectangularArray(
    Geometry=construct_point_3,
    Cell=rectangle_2.Rectangle,
    XCount=expr("x+1", number_slider_2),
    YCount=expr("x+1", number_slider_3))  # -> Geometry, Transform
move = Move(Geometry=construct_point_3, Motion=unit_x)  # -> Geometry, Transform
merge = Merge(Data1=flatten(rectangular_array.Geometry), Data2=flatten(move.Geometry))

# ----
# Performance
number_slider_5 = Slider(0, range=0..1)

# ----
# Decode the points on the grid
deconstruct = Deconstruct(Point=rectangle_grid.Points)  # -> XComponent, YComponent, ZComponent
hops_2 = Hops(
    Z1=deconstruct.XComponent,
    Z2=deconstruct.YComponent,
    P=number_slider_5,
    CacheResultsInMemory=False,
    CacheSolveResults=False,
    RemoteDefinitionLocation="http://127.0.0.1:5000/decoder",
    RemoteSolveVersion=(0, 1, 0),
    ShowInput_Enabled=False,
    ShowInput_Path=False,
    SynchronousSolve=True)

# ----
# Decode the moving point
deconstruct_2 = Deconstruct(Point=construct_point_2)  # -> XComponent, YComponent, ZComponent
hops_3 = Hops(
    Z1=deconstruct_2.XComponent,
    Z2=deconstruct_2.YComponent,
    P=number_slider_5,
    CacheResultsInMemory=False,
    CacheSolveResults=False,
    RemoteDefinitionLocation="http://127.0.0.1:5000/decoder",
    RemoteSolveVersion=(0, 1, 0),
    ShowInput_Enabled=False,
    ShowInput_Path=False,
    SynchronousSolve=True)

# ---- group: Combine results
stack_trees = StackTrees(Data0=hops_2, Data1=hops_3, Reduce=True)

# ----
panel = Panel(stack_trees)

data_3 = Data(stack_trees)
list_item_3 = ListItem(List=data_3, Index=[0, 1, 2, 3, 4], Wrap=True)
list_item_4 = ListItem(List=data_3, Index=5, Wrap=True)  # -> Item, Item1
list_item_5 = ListItem(List=data_3, Index=7, Wrap=True)  # -> Item, Item1
subtraction_3 = Subtraction(A=1, B=list_item_5.Item1)
addition = Addition(A=Slider(1, range=0..4), B=subtraction_3)
unit_z = UnitZ(Factor=Slider(1, range=0..1))
unit_z_2 = UnitZ(Factor=Slider(1, range=0.999..1))
unit_z_3 = UnitZ(Factor=list_item_5.Item1)
unit_z_4 = UnitZ(Factor=addition)
xy_plane = XYPlane(Origin=graft(merge))
move_2 = Move(Geometry=xy_plane, Motion=unit_z)  # -> Geometry, Transform
move_3 = Move(Geometry=move_2.Geometry, Motion=unit_z_2)  # -> Geometry, Transform
move_4 = Move(Geometry=move_3.Geometry, Motion=unit_z_3)  # -> Geometry, Transform
move_5 = Move(Geometry=move_4.Geometry, Motion=unit_z_4)  # -> Geometry, Transform
vector_xyz = VectorXYZ(XComponent=0, YComponent=list_item_5.Item, ZComponent=Slider(0.5, range=0.1..0.8))  # -> Vector, Length
list_item_6 = ListItem(List=list_item_3, Index=0, Wrap=True)  # -> Item, Item1, Item2, Item3, Item4
move_6 = Move(Geometry=move_5.Geometry, Motion=vector_xyz.Vector)  # -> Geometry, Transform
circle_3 = Circle(Plane=xy_plane, Radius=list_item_6.Item)
circle_4 = Circle(Plane=move_2.Geometry, Radius=list_item_6.Item1)
circle_5 = Circle(Plane=move_3.Geometry, Radius=list_item_6.Item2)
circle_6 = Circle(Plane=move_4.Geometry, Radius=list_item_6.Item3)
circle_7 = Circle(Plane=move_5.Geometry, Radius=list_item_6.Item4)
circle_8 = Circle(Plane=move_6.Geometry, Radius=Slider(4, range=0..10))
entwine = Entwine(Branch00=circle_3, Branch01=circle_4, Branch02=circle_5, Branch03=circle_6, Branch04=circle_7, FlattenInputs=True)
divide_curve = DivideCurve(Curve=circle_8, Count=Slider(50, range=0..100), Kinks=False)  # -> Points, Tangents, Parameters
unit_z_5 = UnitZ(Factor=list_item_4.Item)
unit_z_6 = UnitZ(Factor=list_item_4.Item1)
panel_2 = Panel("""1
0
0
0
0
0
0
0
0
0""")
panel_3 = Panel("""0
0
0
0
1
0
1
0
0
0""")
divide_curve_2 = DivideCurve(Curve=entwine, Count=10, Kinks=False)  # -> Points, Tangents, Parameters
divide_curve_3 = DivideCurve(Curve=entwine, Count=Slider(5, range=0..10), Kinks=False)  # -> Points, Tangents, Parameters
panel_4 = Panel("""0
0
0
0
0
1
0
0
0
0""")
sift_pattern = SiftPattern(List=divide_curve.Points, SiftPattern=panel_2)  # -> Output0, Output1
sift_pattern_2 = SiftPattern(List=divide_curve.Points, SiftPattern=panel_3)  # -> Output0, Output1
sift_pattern_3 = SiftPattern(List=divide_curve.Points, SiftPattern=panel_4)  # -> Output0, Output1
polyline = PolyLine(Vertices=divide_curve_2.Points, Closed=True)
move_7 = Move(Geometry=sift_pattern.Output1, Motion=unit_z_5)  # -> Geometry, Transform
move_8 = Move(Geometry=sift_pattern_3.Output1, Motion=unit_z_6)  # -> Geometry, Transform
explode = Explode(Curve=polyline, Recursive=True)  # -> Segments, Vertices
clean_tree = CleanTree(RemoveNulls=True, RemoveInvalid=True, RemoveEmpty=False, Tree=move_7.Geometry)  # -> graft(Tree)
clean_tree_2 = CleanTree(RemoveNulls=True, RemoveInvalid=True, RemoveEmpty=False, Tree=sift_pattern_2.Output1)
clean_tree_3 = CleanTree(RemoveNulls=True, RemoveInvalid=True, RemoveEmpty=False, Tree=move_8.Geometry)
number_slider_6 = Slider(1, range=0..10)
number_slider_7 = Slider(5, range=0..10)
number_slider_8 = Slider(1, range=0..10)
number_slider_9 = Slider(4, range=0..10)

panel_5 = Panel(subtraction_3)
trim_tree = TrimTree(Tree=divide_curve_3.Points, Depth=1)
trim_tree_2 = TrimTree(Tree=explode.Segments, Depth=2)

# ---- group: Column tie
geometry = Geometry(explode.Segments)

# ----
flip_matrix = FlipMatrix(Data=trim_tree)
polyline_2 = PolyLine(Vertices=flip_matrix, Closed=False)
explode_2 = Explode(Curve=polyline_2, Recursive=True)  # -> Segments, Vertices
flip_matrix_2 = FlipMatrix(Data=trim_tree_2)
list_item_7 = ListItem(List=explode_2.Vertices, Index=4, Wrap=True)
list_item_8 = ListItem(List=flip_matrix_2, Index=4, Wrap=True)
line = Line(StartPoint=list_item_7, EndPoint=clean_tree)
end_points = EndPoints(Curve=list_item_8)  # -> Start, End

trim_tree_3 = TrimTree(Tree=end_points.End, Depth=1)

# ---- group: Column
geometry_2 = Geometry(polyline_2)

# ---- group: Girder
geometry_3 = Geometry(line)

# ----
partition_list = PartitionList(List=flatten(geometry_2), Size=5)  # -> simplify(Chunks)

dispatch = Dispatch(List=trim_tree_3, DispatchPattern=[True, False])  # -> graft(ListA), ListB
duplicate_data = DuplicateData(Data=dispatch.ListA, Number=2, Order=True)
line_2 = Line(StartPoint=graft(clean_tree_3), EndPoint=dispatch.ListA)
shift_list = ShiftList(List=partition_list, Shift=1, Wrap=True)  # -> simplify(List)
ruled_surface = RuledSurface(CurveA=partition_list, CurveB=shift_list)
point_on_curve = PointOnCurve(geometry_3, parameter=0.25)

trim_tree_4 = TrimTree(Tree=duplicate_data, Depth=2)
partition_list_2 = PartitionList(List=trim_tree_4, Size=10)
panel_6 = Panel(partition_list_2)

# ---- group: Column
braced_grid_2_d_structure = BracedGrid2DStructure(Surface=ruled_surface, UDivisions=number_slider_7, VDivisions=number_slider_8)  # -> PrimaryLines, BraceLines, StructureNodes
braced_grid_1_d_structure = BracedGrid1DStructure(Surface=ruled_surface, UDivisions=number_slider_7, VDivisions=number_slider_8)  # -> PrimaryLines, BraceLines, StructureNodes

# ----
line_3 = Line(StartPoint=clean_tree_2, EndPoint=partition_list_2)
dispatch_2 = Dispatch(List=line_3, DispatchPattern=[True, False])  # -> ListA, ListB
shift_list_2 = ShiftList(List=dispatch_2.ListB, Shift=Slider(4, range=0..10), Wrap=True)
entwine_2 = Entwine(Branch00=geometry_3, Branch01=shift_list_2, FlattenInputs=True)
entwine_3 = Entwine(Branch00=geometry_3, Branch01=dispatch_2.ListA, FlattenInputs=True)
entwine_4 = Entwine(Branch00=dispatch_2.ListA, Branch01=line_2, FlattenInputs=True)
entwine_5 = Entwine(Branch00=dispatch_2.ListB, Branch01=line_2, FlattenInputs=True)
flip_matrix_3 = FlipMatrix(Data=entwine_2)
flip_matrix_4 = FlipMatrix(Data=entwine_3)
flip_matrix_5 = FlipMatrix(Data=entwine_4)
flip_matrix_6 = FlipMatrix(Data=entwine_5)
loft = Loft(Curves=flip_matrix_3, Options={Adjust=True, Closed=False, LoftEnds=0, LoftSimp=1, LoftType=0, Rebuild=10, Refit=0.01})
loft_2 = Loft(Curves=flip_matrix_4, Options={Adjust=True, Closed=False, LoftEnds=0, LoftSimp=1, LoftType=0, Rebuild=10, Refit=0.01})
loft_3 = Loft(Curves=flip_matrix_5, Options={Adjust=True, Closed=False, LoftEnds=0, LoftSimp=1, LoftType=0, Rebuild=10, Refit=0.01})
loft_4 = Loft(Curves=flip_matrix_6, Options={Adjust=True, Closed=False, LoftEnds=0, LoftSimp=1, LoftType=0, Rebuild=10, Refit=0.01})
list_item_9 = ListItem(List=braced_grid_2_d_structure.PrimaryLines, Index=Slider(15, range=0..100), Wrap=True)
list_item_10 = ListItem(List=braced_grid_2_d_structure.StructureNodes, Index=15, Wrap=True)  # -> simplify(Item)

# ---- group: Roof
braced_grid_1_d_structure_2 = BracedGrid1DStructure(Surface=[loft, loft_2], UDivisions=Slider(1, range=0..10), VDivisions=number_slider_9)  # -> PrimaryLines, BraceLines, StructureNodes
braced_grid_1_d_structure_3 = BracedGrid1DStructure(Surface=[loft_3, loft_4], UDivisions=Slider(1, range=0..1), VDivisions=number_slider_9)  # -> PrimaryLines, BraceLines, StructureNodes

# ----
end_points_2 = EndPoints(Curve=list_item_9)  # -> Start, End
trim_tree_5 = TrimTree(Tree=end_points_2.Start, Depth=1)
trim_tree_6 = TrimTree(Tree=list_item_10, Depth=1)  # -> simplify(Tree)
polyline_3 = PolyLine(Vertices=trim_tree_5, Closed=True)

polygon_center = PolygonCenter(Polyline=polyline_3)  # -> CenterV, CenterE, CenterA
line_4 = Line(StartPoint=polygon_center.CenterV, EndPoint=trim_tree_6)

sort_points = SortPoints(Points=polygon_center.CenterV)  # -> simplify(graft(Points)), Indices
geometry_4 = Geometry(simplify(line_4))

# ---- group: All elements
curve = Curve(simplify(braced_grid_1_d_structure_2.PrimaryLines))
curve_2 = Curve(braced_grid_1_d_structure_2.BraceLines)
curve_3 = Curve(braced_grid_1_d_structure_3.PrimaryLines)
curve_4 = Curve(braced_grid_1_d_structure_3.BraceLines)
curve_5 = Curve(braced_grid_1_d_structure.PrimaryLines)
curve_6 = Curve(braced_grid_1_d_structure.BraceLines)

# ----
list_item_11 = ListItem(List=curve_5, Index=Slider(9, range=0..10), Wrap=True)
end_points_3 = EndPoints(Curve=list_item_11)  # -> Start, End

# ---- group: All elements (continued)
line_5 = Line(StartPoint=end_points_3.End, EndPoint=point_on_curve)  # -> simplify(Line)

# ----
# VISUALIZE SAMPLES
partition_list_3 = PartitionList(List=flatten(curve), Size=130)  # -> simplify(Chunks)
partition_list_4 = PartitionList(List=flatten(curve_2), Size=40)  # -> simplify(Chunks)
partition_list_5 = PartitionList(List=flatten(curve_3), Size=130)  # -> simplify(Chunks)
partition_list_6 = PartitionList(List=flatten(curve_5), Size=80)  # -> simplify(Chunks)
partition_list_7 = PartitionList(List=flatten(curve_6), Size=25)  # -> simplify(Chunks)
trim_tree_7 = TrimTree(Tree=line_5, Depth=1)
merge_2 = Merge(
    Data1=simplify(partition_list_3),
    Data2=simplify(geometry_4),
    Data3=simplify(partition_list_4),
    Data4=partition_list_5,
    Data5=partition_list_6,
    Data6=partition_list_7,
    Data7=trim_tree_7)
merge_3 = Merge(Data1=flatten(gradient), Data2=flatten(colour_swatch))
custom_preview_3 = CustomPreview(Geometry=merge_2, Material=graft(merge_3))

explode_tree = ExplodeTree(Data=merge_2)  # -> Branch0, Branch1, Branch2, Branch3, Branch4, Branch5, Branch6, Branch7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
